# Grasshopper definition vector_ball_01.gh (Grasshopper 0.9.76)
# plug-ins: Python Interpreter, Kangaroo Components

number_slider = Slider(184, range=0..500)
timer = Timer(TimerInterval=20, Target=counter)
counter = Counter(Reset=Toggle(True))
python = PythonScript(time=counter)  # -> out, a; inputs time: Int32
# ---------- python: Python ----------
import rhinoscriptsyntax as rs


xPos = 5
yPos = 5
xSpeed = 5
ySpeed = 8

boundary = 90

for t in range(time):
    xPos += xSpeed
    yPos += ySpeed
    
    if xPos < 0 or xPos > boundary:
        xSpeed *= -1
    if yPos < 0 or yPos > boundary:
        ySpeed *= -1
        
a = rs.AddSphere([xPos,yPos,0],5)
# ---------- end python ----------
