# Grasshopper definition vector_ball_02.gh (Grasshopper 0.9.76)
# plug-ins: Python Interpreter, Kangaroo Components

timer = Timer(TimerInterval=20, Target=counter)
vec = VectorXYZ(XComponent=Slider(4, range=0..5), YComponent=Slider(2, range=0..5), ZComponent=Slider(1, range=0..5))  # -> Vector, Length
python = PythonScript(time=Slider(1000, range=0..1000), velocity=vec.Vector)  # -> out, a; inputs time: Int32, velocity: Vector3d
# ---------- python: Python ----------
import rhinoscriptsyntax as rs

pos = [50,50,1]
boundary = 90

vel = velocity

pList = []
for t in range(time):
    
    pos = rs.VectorAdd(pos,vel)
    
    if pos[0] < 0 or pos[0] > boundary:
        vel[0] *= -1
    if pos[1] < 0 or pos[1] > boundary:
        vel[1] *= -1
    
    pt = rs.AddPoint(pos)
    pList.append(pt)

a = pList
# ---------- end python ----------
counter = Counter(Reset=Toggle(True))
item = ListItem(List=python.a, Index=counter, Wrap=True)
sph = Sphere(Base=item, Radius=Slider(23, range=0..25))
