# Grasshopper definition walker_01.gh (Grasshopper 0.9.76)
# plug-ins: Python Interpreter

python = PythonScript(seed=Slider(2, range=0..10), time=Slider(1000, range=0..1000))  # -> out, a; inputs seed: Int32, time: Int32
# ---------- python: Python ----------
import rhinoscriptsyntax as rs
#randomness
import random as r
r.seed(seed)
#class

class Walker:
    
    def __init__(self):
        self.x = 0
        self.y = 0
        
    def display(self):
        shape = rs.AddPoint(self.x,self.y,0)
        return shape
        
    def step(self):
        choice = r.randint(0,3)
        if(choice == 0):
            self.x += 1
        elif(choice == 1):
            self.y += 1
        elif(choice == 2):
            self.x -= 1
        else:
            self.y -= 1
#time
w = Walker()
pList = []
for t in range(time):
    w.step()
    pList.append(w.display())
    
a = pList
print pList
# ---------- end python ----------
intcrv_t = InterpolateT(Vertices=python.a, Degree=3, TangentStart=Vector(0, 0, 0), TangentEnd=Vector(0, 0, 0), KnotStyle=1)  # -> Curve, Length, Domain
