# Grasshopper definition walker_02.gh (Grasshopper 0.9.76)
# plug-ins: Python Interpreter

# ---- group: Gaussian Randomness
python = PythonScript(seed=Slider(5, range=0..10), count=Slider(224, range=0..2000), mean=Slider(0, range=0..10), sd=Slider(19, range=0..50))  # -> out, a; inputs seed: Int32, count: Int32
# ---------- python: Python ----------
#Generates a 3d Walker

import rhinoscriptsyntax as rs
import random as r
r.seed(seed)


pList = []
for n in range(count):
    rand = r.gauss(mean,sd)
    rand2 = r.gauss(mean,sd)
    rand3 = r.gauss(mean,sd)
    pList.append(rs.AddPoint(rand,rand2,rand3))
    
a = pList
# ---------- end python ----------

# ----
python_2 = PythonScript(seed=Slider(5, range=0..10), time=Slider(2000, range=0..2000))  # -> out, a; inputs seed: Int32, time: Int32
# ---------- python_2: Python ----------
#Generates a 3d Walker

import rhinoscriptsyntax as rs
import random as r
r.seed(seed)

class Walker:
    
    def __init__(self):
        self.x = 0
        self.y = 0
        self.z = 0
        
    def display(self):
        shape = rs.AddPoint(self.x,self.y,self.z)
        return shape
        
    def step(self):
       randX = r.uniform(-1,1)
       randY = r.uniform(-1,1)
       randZ = r.uniform(-1,1)
     
       
       self.x += randX
       self.y += randY
       self.z += randZ
      
#time

w = Walker()
pList = []
for t in range(time):
    w.step()
    pList.append(w.display())
    
a = pList
print pList
# ---------- end python_2 ----------
intcrv = Interpolate(Vertices=python_2.a, Degree=3, Periodic=False, KnotStyle=1)  # -> Curve, Length, Domain
